# Grasshopper definition Twist.ghx (Grasshopper 1.0.8)

geomin = Geometry(<extrusion referenced from the Rhino model>)
volume = Volume(Geometry=geomin)  # -> Volume, Centroid
Z = UnitZ(Factor=1)
move = Move(Geometry=volume.Centroid, Motion=Z)  # -> Geometry, Transform
rad = Radians(Degrees=Slider(2, range=0..360))
ln = Line(StartPoint=volume.Centroid, EndPoint=move.Geometry)
twist = Twist(Geometry=geomin, Axis=ln, Angle=rad, Infinite=True, Rigid=False)
geomout = Geometry(twist)
